vi "asil_RX.gvi"   [LabVIEW Communications System Design Software 2.0.1]
panel controls:
  "IQ rate": f64 = 400000
  "carrier frequency": f64 = 915000000
  "gain (dB)": f64
  "active antenna": string = "RX2"
  "symbol rate (sym/s)": i64 = 10000
  "message length (bits)": i64 = 1000
  "Device names": string
panel indicators:
  "actual IQ rate": f64
  "actual carrier frequency": f64
  "actual gain (dB)": f64
  "error out": error
  "BER": f64
  "trigger found?": bool
  "Baseband Output": cluster{"t0": f64, "dt": f64, "Y": f64[]}
  "Output bits": f64[]
  "decimal": f64[]
  "Output bits_2": f64[]
  "Variable: len": f64
  "size(s)": i32
types:
  "filter structure.gtype" = u32
  "filter.gtype" = cluster{"filter structure": "filter structure.gtype", "forward coefficients": f64[], "reverse coefficients": f64[], "sampling frequency": f64}
uses:
  NI::Analysis::Conditioning::Unwrap Phase.gvi
  NI::Analysis::Filtering::Filtering with Initial Conditions (DBL).gvi
  NI::Analysis::Operations::1D Convolution (DBL).gvi
  NI::Analysis::Resampling::Decimate (single shot, DBL).gvi
diagram:
  call "niUSRP Open Rx Session.gvi"(niUSRP Device=$"Device names") -> (error out=w1, session handle out=w2)
  call "niUSRP Configure Signal.gvi"(session handle=w2, IQ rate=$"IQ rate", carrier frequency=$"carrier frequency", gain=$"gain (dB)", error in (no error)=w1, active antenna=$"active antenna") -> (session handle out=w3, coerced IQ rate=w4, coerced carrier frequency=w5, coerced gain=w6, Error Out=w7)
  call "niUSRP Initiate.gvi"(session handle=w3, error in (no error)=w7) -> (session handle out=w8, Error Out=w9)
  # samples/symbol = Decimation Factor
  Divide(x=w4, y=$"symbol rate (sym/s)") -> w10
  Multiply($"message length (bits)", w10) -> w11
  Multiply(2, w11) -> w12
  call "niUSRP Fetch Rx Data (CDB Cluster).gvi"(session handle=w8, number of samples=w12, error in (no error)=w9) -> (session handle out=w13, data=w14, Error Out=w15)
  call "niUSRP Abort.gvi"(Handle in=w13, error in (no error)=w15) -> (Handle out=w16, Error Out=w17)
  call "niUSRP Close Session.gvi"(handle in=w16, error in=w17) -> (error out=w18)
  call "Simple Error Handler.gvi"(error in=w18) -> (error out=w19)
  $"error out" <- w19
  # BER
  $"actual IQ rate" <- w4
  $"actual carrier frequency" <- w5
  # get phase
  # no. samples
  Property Node(instance in=w14) -> ("dt"=w20, "Y"=w21)
  Property Node(instance in="filter.gtype" {all zero or empty}, "filter structure"=3, "forward coefficients"=[1, -1], "reverse coefficients"=[1, -1]) -> (instance out=w22)
  Complex To Polar(r * e^(i*theta)=w21) -> (theta=w23)
  call "Unwrap Phase.gvi"(input phase=w23, phase unit="degree in, radian out"(3)) -> (unwrapped phase=w24)
  call "Filtering with Initial Conditions (DBL).gvi"(signal=w24, filter=w22) -> (filtered signal=w25)
  call "Median Filter2.gvi"(X=w25, left rank=5) -> (Filtered X=w26)
  # unwrap
  # differentiate
  call "MT Generate Filter Coefficients.gvi"(pulse shaping filter="none", matched samples per symbol=w10, modulation type="FSK") -> (matched filter coefficients=w27)
  # remove spikes
  # matched filter
  call "1D Convolution (DBL).gvi"(x=w26, y=w27) -> (x * y=w28)
  w29 = cluster{"t0": f64, "dt": f64, "Y": f64[]} {all zero or empty}
  # pulse sync
  Property Node(instance in=w29, "dt"=w20, "Y"=w28) -> (instance out=w30)
  # eye diagram
  call "MT Format Eye Diagram (complex).gvi"(waveform=w30, symbol rate=$"symbol rate (sym/s)", eye length=2)
  $"actual gain (dB)" <- w6
  $"Baseband Output" <- w30
  # sample
  call "PulseAlign(real).gvi"(Input Signal=w30, Receiver Sampling Factor=w10) -> (Aligned Signal=w31)
  # frame sync
  Property Node(instance in=w31) -> ("Y"=w32)
  # threshold & symbol mapping
  call "Decimate (single shot, DBL).gvi"(input array=w32, decimating factor=w10) -> (decimated array=w33)
  Is Greater(x=w33, y=0) -> w34
  Boolean To Integer(Boolean=w34) -> (0, 1=w35)
  $"Output bits" <- w35
  Array Size(array=w28) -> (size(s)=w36)
  $"size(s)" <- w36
  Math Node("a"=w28) -> ("new"=w37, "len"=w38)
  ~~~
  a=a+0.4;
  a=a*2500000;
  len=length(a);
  for k=1:length(a);
  if abs(a(i)-1)<abs(a(i)-0);
  a(i)=1;
  else a(i)=0
  end
  end
  for i=length(a)/6
  c= a(6*i-5:6*i);
  if c(1,1)==1;
  new(i)=(-1/100)*( c(6)+2*c(5)+4*c(4)+ 8*c(3) +16*c(2));

  else new(i)=(1/100)*( c(6)+2*c(5)+4*c(4)+ 8*c(3) +16*c(2));
  end
  end
  ~~~
  $decimal <- w37
  $"Variable: len" <- w38
  $"Output bits_2" <- w37
