vi "asil_TX.gvi"   [LabVIEW Communications System Design Software 2.0.1]
panel controls:
  "IQ rate": f64 = 400000
  "carrier frequency": f64 = 915000000
  "gain (dB)": f64
  "active antenna": string = "TX1"
  "symbol rate (sym/s)": i32 = 10000
  "stop": bool
  "Device names": string
  "pulse shaping filter": T2 = "none"
panel indicators:
  "actual IQ rate": f64
  "actual carrier frequency": f64
  "actual gain (dB)": f64
  "error out": error
  "Message Waveform": waveform<f64>
  "Baseband Power Spectrum": T1
  "voice": f64[]
types:
  T1 = cluster{"f0": f64, "df": f64, "magnitude": f64[]}
  T2 = enum{"none", "Raised Cosine", "Root Raised Cos", "Gaussian"}
  "filter structure.gtype" = u32
  "filter.gtype" = cluster{"filter structure": "filter structure.gtype", "forward coefficients": f64[], "reverse coefficients": f64[], "sampling frequency": f64}
uses:
  NI::Analysis::Resampling::Upsample (DBL).gvi
  NI::Analysis::Operations::1D Convolution (DBL).gvi
  NI::Analysis::Filtering::Filtering with Initial Conditions (DBL).gvi
diagram:
  call "record.gvi"() -> (voice=w1)
  Array Index(array=w1) -> (out0[1]=w2)
  Property Node(instance in=w2) -> ("Y"=w3)
  $voice <- w3
  call "niUSRP Open Tx Session.gvi"(Device names=$"Device names") -> (session handle out=w4, Error Out=w5)
  call "niUSRP Configure Signal.gvi"(session handle=w4, IQ rate=$"IQ rate", carrier frequency=$"carrier frequency", gain=$"gain (dB)", error in (no error)=w5, active antenna=$"active antenna") -> (session handle out=w6, coerced IQ rate=w7, coerced carrier frequency=w8, coerced gain=w9)
  Reciprocal(x=w7) -> w10
  # Pulse Shaping
  Property Node(instance in="filter.gtype" {all zero or empty}, "filter structure"=2, "forward coefficients"=[1], "reverse coefficients"=[1, -1]) -> (instance out=w11)
  # samples/symbol = upsample factor
  Divide(x=w7, y=$"symbol rate (sym/s)") -> w12
  call "MT Generate Filter Coefficients.gvi"(pulse shaping filter=$"pulse shaping filter", pulse shaping samples per symbol=w12, modulation type="FSK") -> (pulse shaping filter coefficients=w13)
  call "binary_convert.gvi"(input_b=w3) -> (output_b=w14)
  Multiply(w14, 2) -> w15
  # Upsampling
  Decrement(x=w15) -> w16
  call "Upsample (DBL).gvi"(input array=w16, upsampling factor=w12) -> (upsampled array=w17)
  call "1D Convolution (DBL).gvi"(x=w17, y=w13) -> (x * y=w18)
  Absolute Value(x=w18) -> w19
  Array Max And Min(array=w19) -> (max value=w20)
  Divide(x=w18, y=w20) -> w21
  call "Filtering with Initial Conditions (DBL).gvi"(signal=w21, filter=w11) -> (filtered signal=w22)
  Multiply(5000, w22) -> w23
  Multiply(w23, PiTimes2) -> w24
  Multiply(w24, w10) -> w25
  Polar To Complex(r=1, theta=w25) -> (r * e^(i*theta)=w26)
  w27 = cluster{"t0": timestamp, "dt": f64, "Y": c128[]} {all zero or empty}
  Property Node(instance in=w27, "Y"=w26, "dt"=w10) -> (instance out=w28)
  call "FFT Power Spectrum for 1 Chan (CDB)2.gvi"(time signal=w28, dB On (F)=TRUE) -> (power spectrum=w29, Error Out=w30)
  while {
    call "niUSRP Write Tx Data (CDB).gvi"(session handle=w6, data=w26, end of data?=$stop, error in (no error)=w30) -> (session handle out=w31, Error Out=w32)
    Logical Or(w32, $stop) -> w33
    stop if w33
  }
  call "niUSRP Close Session.gvi"(handle in=w31, error in=w32) -> (error out=w34)
  call "Simple Error Handler.gvi"(error in=w34) -> (error out=w35)
  $"error out" <- w35
  $"actual IQ rate" <- w7
  $"actual carrier frequency" <- w8
  $"actual gain (dB)" <- w9
  # Modulation
  Build Waveform Node(Y=w21, dt=w10) -> (output waveform=w36)
  $"Message Waveform" <- w36
  $"Baseband Power Spectrum" <- w29
