vi "binary_convert.gvi"   [LabVIEW Communications System Design Software 2.0.1]
inputs:
  "input_b": f64[]
outputs:
  "output_b": f64[]
diagram:
  Multiply(100, $input_b) -> w1
  Round To Nearest(number=w1) -> w2
  Absolute Value(x=w2) -> w3
  Quotient And Remainder(x=w3, y=2) -> (floor(x/y)=w4, x-y*floor(x/y)=w5)
  Quotient And Remainder(x=w4, y=2) -> (floor(x/y)=w6, x-y*floor(x/y)=w7)
  Is Equal(x=w7, y=1) -> w8
  Boolean To Integer(Boolean=w8) -> (0, 1=w9)
  Is Equal(x=w5, y=1) -> w10
  Boolean To Integer(Boolean=w10) -> (0, 1=w11)
  Is Less(x=w2, y=0) -> w12
  Boolean To Integer(Boolean=w12) -> (0, 1=w13)
  Quotient And Remainder(x=w6, y=2) -> (floor(x/y)=w14, x-y*floor(x/y)=w15)
  Quotient And Remainder(x=w14, y=2) -> (floor(x/y)=w16, x-y*floor(x/y)=w17)
  Is Equal(x=w17, y=1) -> w18
  Boolean To Integer(Boolean=w18) -> (0, 1=w19)
  # Upsampling
  Quotient And Remainder(x=w16, y=2) -> (x-y*floor(x/y)=w20)
  Is Equal(x=w20, y=1) -> w21
  # Pulse Shaping
  Boolean To Integer(Boolean=w21) -> (0, 1=w22)
  Is Equal(x=w15, y=1) -> w23
  Boolean To Integer(Boolean=w23) -> (0, 1=w24)
  # Modulation
  # Modulation
  Math Node("a"=w13, "b"=w22, "c"=w19, "d"=w24, "e"=w9, "f"=w11) -> ("out"=w25)
  ~~~
  for i=1:length(a);
  out(6*i-5:6*i)=[a(i) b(i) c(i) d(i) e(i) f(i)];
  end
  ~~~
  $output_b <- w25
