vi "projectRx.gvi"   [LabVIEW Communications System Design Software 2.0.1]
panel controls:
  "IQ rate": f64 = 400000
  "carrier frequency": f64 = 915000000
  "gain (dB)": f64
  "active antenna": string = "RX2"
  "Device names": string
panel indicators:
  "actual IQ rate": f64
  "actual carrier frequency": f64
  "actual gain (dB)": f64
  "error out": error
  "Baseband Output": cluster{"t0": f64, "dt": f64, "Y": f64[]}
  "Variable: new": f64[]
  "Graph": cluster{"t0": f64, "dt": f64, "Y": f64[]}
  "conv": f64[]
uses:
  NI::Analysis::Conditioning::Unwrap Phase.gvi
  NI::Analysis::Filtering::FIR Filter (DBL).gvi
  NI::Analysis::Filtering::Median Filter.gvi
  NI::Analysis::Operations::1D Convolution (DBL).gvi
diagram:
  call "niUSRP Open Rx Session.gvi"(niUSRP Device=$"Device names") -> (error out=w1, session handle out=w2)
  call "niUSRP Configure Signal.gvi"(session handle=w2, IQ rate=$"IQ rate", carrier frequency=$"carrier frequency", gain=$"gain (dB)", error in (no error)=w1, active antenna=$"active antenna") -> (session handle out=w3, coerced IQ rate=w4, coerced carrier frequency=w5, coerced gain=w6, Error Out=w7)
  call "niUSRP Initiate.gvi"(session handle=w3, error in (no error)=w7) -> (session handle out=w8, Error Out=w9)
  # no. samples
  # samples/symbol = Decimation Factor
  Divide(x=w4, y=6000) -> w10
  Multiply(6000, w10) -> w11
  Multiply(2, w11) -> w12
  # no. samples
  call "niUSRP Fetch Rx Data (CDB Cluster).gvi"(session handle=w8, number of samples=w12, error in (no error)=w9) -> (session handle out=w13, data=w14, Error Out=w15)
  # get phase
  # unwrap
  Property Node(instance in=w14) -> ("dt"=w16, "Y"=w17)
  # matched filter
  w18 = cluster{"t0": f64, "dt": f64, "Y": f64[]} {all zero or empty}
  Complex To Polar(r * e^(i*theta)=w17) -> (theta=w19)
  # differentiate
  # step 1
  call "Unwrap Phase.gvi"(input phase=w19, error in=w15) -> (unwrapped phase=w20, error out=w21)
  call "FIR Filter (DBL).gvi"(x=w20, FIR coefficients=[1, -1]) -> (filtered x=w22)
  # remove spikes
  call "Median Filter.gvi"(signal=w22, left rank=5, error in=w21) -> (filtered signal=w23, error out=w24)
  call "MT Generate Filter Coefficients.gvi"(pulse shaping filter="none", pulse shaping samples per symbol=w10, modulation type="FSK") -> (matched filter coefficients=w25)
  call "1D Convolution (DBL).gvi"(x=w25, y=w23, error in=w24) -> (x * y=w26, error out=w27)
  Add(1.7, w26) -> w28
  Divide(x=w28, y=3) -> w29
  Round To Nearest(number=w29) -> w30
  # pulse sync
  Property Node(instance in=w18, "dt"=w16, "Y"=w30) -> (instance out=w31)
  # eye diagram
  $"Baseband Output" <- w31
  # sample
  Build Waveform Node(Y=w30) -> (output waveform=w32)
  Initialize Array(element=w32) -> w33
  # frame sync
  # threshold & symbol mapping
  call "sound.gvi"(data=w33)
  call "niUSRP Abort.gvi"(Handle in=w13, error in (no error)=w27) -> (Handle out=w34, Error Out=w35)
  call "niUSRP Close Session.gvi"(handle in=w34, error in=w35) -> (error out=w36)
  call "Simple Error Handler.gvi"(error in=w36) -> (error out=w37)
  $"error out" <- w37
  Math Node("out"=w30) -> ("new"=w38)
  ~~~
  for i=1:1000
  dec= out(6*i-5:6*i);
  if dec(1)==0;
  new(i)=dec(6)+dec(5)*2+dec(4)*4+dec(3)*8+dec(2)*16;
  else
  new(i)=-(dec(6)+dec(5)*2+dec(4)*4+dec(3)*8+dec(2)*16);
  end
  end
  new=new/100;
  ~~~
  w39 = cluster{"t0": f64, "dt": f64, "Y": f64[]} {all zero or empty}
  # BER
  Property Node(instance in=w39, "dt"=w16, "Y"=w38) -> (instance out=w40)
  $Graph <- w40
  $"actual IQ rate" <- w4
  $"actual carrier frequency" <- w5
  $"actual gain (dB)" <- w6
  # step 2
  $conv <- w26
  $"Variable: new" <- w38
