vi "record.gvi"   [LabVIEW Communications System Design Software 2.0.1]
outputs:
  "voice": waveform<f64>[]
panel controls:
  "Input device ID": u32
  "Input mode": "Sampling Mode.gtype" = "Continuous Samples"(1)
  "Output device ID": u32
  "Output mode": "Sampling Mode.gtype" = "Continuous Samples"(1)
  "Stop": bool
types:
  "Sampling Mode.gtype" = i32
  "Sound Data Format.gtype" = cluster{"sample rate (S/s)": f64, "number of channels": i32, "bits per sample": i32}
diagram:
  while {
    w1 = "Sound Data Format.gtype" {"sample rate (S/s)"=500, "number of channels"=2, "bits per sample"=16}
    call "Sound Input Configure.gvi"(device ID=$"Input device ID", sound format=w1, sample mode=$"Input mode", number of samples/ch=1000) -> (task ID=w2, error out=w3)
    call "Sound Input Start.gvi"(task ID in=w2, error in=w3) -> (task ID out=w4, error out=w5)
    call "Sound Input Read.gvi"(task ID in=w4, error in=w5, number of samples/ch=1000) -> (data=w6, error out=w7)
    $voice <- w6
    w8 = "Sound Data Format.gtype" {"sample rate (S/s)"=500, "number of channels"=2, "bits per sample"=16}
    call "Sound Output Configure.gvi"(device ID=$"Output device ID", sound format=w8, error in=w7, sample mode=$"Output mode", number of samples/ch=1000) -> (task ID=w9, error out=w10)
    call "Sound Output Write.gvi"(task ID in=w9, data=w6, error in=w10) -> (task ID out=w11, error out=w12)
    call "Sound Output Start.gvi"(task ID in=w11, error in=w12) -> (task ID out=w13, error out=w14)
    call "Sound Output Wait.gvi"(task ID in=w13, error in=w14) -> (task ID out=w15, error out=w16)
    call "Sound Output Stop.gvi"(task ID in=w15, error in=w16) -> (task ID out=w17, error out=w18)
    call "Sound Output Clear.gvi"(task ID=w17, error in=w18)
    continue if $Stop
  }
