vi "DTW.gvi"   [LabVIEW Communications System Design Software 2.0.1]
panel indicators:
  "all rows": f64[]
  "all rows_2": f64[]
  "size(s)": i32
  "Distance": f64
  "Reference": waveform<f64>
  "Test": waveform<f64>
  "voice": f64[]
  "Result": string
  "FORWARD": bool
  "LEFT": bool
  "RIGHT": bool
  "BACKWARD": bool
diagram:
  call "record.gvi"() -> (message=w1)
  Array Index(array=w1) -> (out0[1]=w2)
  Property Node(instance in=w2) -> ("Y"=w3)
  $"all rows" <- w3
  Reshape Array(inArray=w3, size=1000) -> w4
  Build Waveform Node(Y=w4) -> (output waveform=w5)
  $Test <- w5
  $voice <- w3
  w6 = path "C:\\Users\\LENOVO\\Desktop\\3th year\\EE3001\\PROJECT\\HERŞEYY\\SOUND DATAS\\left_reference_2.csv"
  call "Read from Spreadsheet File (DBL).gvi"(file path=w6) -> (all rows=w7)
  Reshape Array(inArray=w7, size=1000) -> w8
  $"all rows_2" <- w8
  Array Size(array=w4) -> (size(s)=w9)
  Array Size(array=w8) -> (size(s)=w10)
  for {
    w11 = each element of w4
    for {
      w13 = each element of w8
      Subtract(x=w11, y=w13) -> w15
      Square(x=w15) -> w16
      Build Array(w16) -> w17
      Add Array Elements(numeric array=w17) -> (sum=w18)
      Square Root(x=w18) -> w19
      append w19 to w14
    }
    append w14 to w12
  }
  Initialize Array(element=0, size=w10, size=w9) -> w20
  Math Node("euc"=w12, "n"=w9, "r"=w10, "D"=w20) -> ("cost"=w21, "left"=w22, "result"=w23)
  ~~~
  D(1,1)=euc(1,1);
  D(1,1)=euc(1,1);
  for j=2:r
      D(1,j)=D(1,j-1)+ euc(1,j);
  end

  for i=2:n
      D(i,1)=D(i-1,1)+ euc(i,1);
  end

  for i=2:n
  	for j=2:r
      	a=D(i-1,j)+euc(i,j);
      	b=D(i-1,j-1)+euc(i,j);
      	c=D(i,j-1)+euc(i,j);
      	D(i,j)=min([b,a,c]);
      end
  end
  cost=D(n,r);

  if cost<20
  result='The sound is LEFT';
  left=true;
  else result='The sound is NOT LEFT';
  left=false;

  end
  ~~~
  $Distance <- w21
  $Result <- w23
  Array Size(array=w8) -> (size(s)=w24)
  $"size(s)" <- w24
  $LEFT <- w22
  Build Waveform Node(Y=w8) -> (output waveform=w25)
  $Reference <- w25
