vi "DTW_main.gvi"   [LabVIEW Communications System Design Software 2.0.1]
panel indicators:
  "Forward_Distance": f64
  "Bckward_Distance": f64
  "Right_Distance": f64
  "Left_Distance": f64
  "Variable: LEFT": bool
  "Variable: RIGHT": bool
  "Variable: FORWARD": bool
  "Variable: BACKWARD": bool
  "RESULT": string
  "VOICE": f64[]
diagram:
  call "record.gvi"() -> (voice=w1)
  Array Index(array=w1) -> (out0[1]=w2)
  Property Node(instance in=w2) -> ("Y"=w3)
  call "left_detection.gvi"(left_input=w3) -> (Left_Distance=w4)
  $Left_Distance <- w4
  call "right_detection.gvi"(right_input=w3) -> (Right_Distance=w5)
  $Right_Distance <- w5
  call "forward_detection.gvi"(forward_input=w3) -> (Forward_Distance=w6)
  call "backward_detection.gvi"(backward_input=w3) -> (Bckward_Distance=w7)
  Math Node("left"=w4, "right"=w5, "forward"=w6, "backward"=w7) -> ("RESULT"=w8, "LEFT"=w9, "RIGHT"=w10, "FORWARD"=w11, "BACKWARD"=w12)
  ~~~
  c=[left,right,forward,backward];
  c=sort(c);
  if c(1)==left
  RESULT='The sound is Left';
  LEFT=true;
  RIGHT=false;
  FORWARD=false;
  BACKWARD=false;
  elseif c(1)==right
  RESULT='The sound is Right';
  LEFT=false;
  RIGHT=true;
  FORWARD=false;
  BACKWARD=false;
  elseif c(1)==forward
  RESULT='The sound is Forward';
  LEFT=false;
  RIGHT=false;
  FORWARD=true;
  BACKWARD=false;
  elseif c(1)==backward
  RESULT='The sound is Backward';
  LEFT=false;
  RIGHT=false;
  FORWARD=false;
  BACKWARD=true;
  end
  ~~~
  $RESULT <- w8
  $"Variable: LEFT" <- w9
  $"Variable: RIGHT" <- w10
  $"Variable: FORWARD" <- w11
  $VOICE <- w3
  $Forward_Distance <- w6
  $"Variable: BACKWARD" <- w12
  $Bckward_Distance <- w7
