vi "left_detection.gvi"   [LabVIEW Communications System Design Software 2.0.1]
inputs:
  "left_input": f64[]
outputs:
  "Left_Distance": f64
panel indicators:
  "voice rows": f64[]
  "reference_rows": f64[]
  "size(s)": i32
  "Reference": waveform<f64>
  "Voice": waveform<f64>
diagram:
  $"voice rows" <- $left_input
  Reshape Array(inArray=$left_input, size=1000) -> w1
  Build Waveform Node(Y=w1) -> (output waveform=w2)
  $Voice <- w2
  w3 = path "C:\\Users\\LENOVO\\Desktop\\3th year\\EE3001\\PROJECT\\HERŞEYY\\SOUND DATAS\\left_reference_2.csv"
  call "Read from Spreadsheet File (DBL).gvi"(file path=w3) -> (all rows=w4)
  Reshape Array(inArray=w4, size=1000) -> w5
  $reference_rows <- w5
  Array Size(array=w5) -> (size(s)=w6)
  Array Size(array=w1) -> (size(s)=w7)
  for {
    w8 = each element of w1
    for {
      w10 = each element of w5
      Subtract(x=w8, y=w10) -> w12
      Square(x=w12) -> w13
      Build Array(w13) -> w14
      Add Array Elements(numeric array=w14) -> (sum=w15)
      Square Root(x=w15) -> w16
      append w16 to w11
    }
    append w11 to w9
  }
  Initialize Array(element=0, size=w6, size=w7) -> w17
  Math Node("euc"=w9, "n"=w7, "r"=w6, "D"=w17) -> ("distance"=w18)
  ~~~
  D(1,1)=euc(1,1);
  for j=2:r
      D(1,j)=D(1,j-1)+ euc(1,j);
  end

  for i=2:n
      D(i,1)=D(i-1,1)+ euc(i,1);
  end

  for i=2:n
  	for j=2:r
      	a=D(i-1,j)+euc(i,j);
      	b=D(i-1,j-1)+euc(i,j);
      	c=D(i,j-1)+euc(i,j);
      	D(i,j)=min([b,a,c]);
      end
  end
  distance=D(n,r);

  %if distance<20
  %result='The sound is LEFT';
  %left=true;
  %else result='The sound is NOT LEFT';
  %left=false;

  %end
  ~~~
  $Left_Distance <- w18
  Build Waveform Node(Y=w5) -> (output waveform=w19)
  $Reference <- w19
  Array Size(array=w5) -> (size(s)=w20)
  $"size(s)" <- w20
