vi "sound.gvi"   [LabVIEW Communications System Design Software 2.0.1]
inputs:
  "data": waveform<f64>[]
panel controls:
  "Output device ID": u32
  "Output mode": "Sampling Mode.gtype" = "Continuous Samples"(1)
  "Stop": bool
types:
  "Sampling Mode.gtype" = i32
  "Sound Data Format.gtype" = cluster{"sample rate (S/s)": f64, "number of channels": i32, "bits per sample": i32}
diagram:
  while {
    w1 = "Sound Data Format.gtype" {"sample rate (S/s)"=200000, "number of channels"=2, "bits per sample"=16}
    call "Sound Output Configure.gvi"(device ID=$"Output device ID", sound format=w1, sample mode=$"Output mode", number of samples/ch=66150) -> (task ID=w2, error out=w3)
    call "Sound Output Write.gvi"(task ID in=w2, data=$data, error in=w3) -> (task ID out=w4, error out=w5)
    call "Sound Output Start.gvi"(task ID in=w4, error in=w5) -> (task ID out=w6, error out=w7)
    call "Sound Output Wait.gvi"(task ID in=w6, error in=w7) -> (task ID out=w8, error out=w9)
    call "Sound Output Stop.gvi"(task ID in=w8, error in=w9) -> (task ID out=w10, error out=w11)
    call "Sound Output Clear.gvi"(task ID=w10, error in=w11)
    continue if $Stop
  }
